# Grasshopper definition materials-json-test.ghx (Grasshopper 1.0.7)
# plug-ins: ShapeDiverForGrasshopper, GrasshopperHyperGooComponents, Human

Y = UnitY(Factor=30)
sddp = ShapeDiverDocumentPayload({AbsoluteTolerance=0, AngleTolerance=0, DistanceDisplayPrecision=0, GltfVersion="Gltf2", GrasshopperVersion="1.0.0007", InputGroups="{}", OutputGroups="{}", RelativeTolerance=0, RhinoVersion="7.37.24107.15001", UnitSystem=0, VersionCreated="1.18.1.0", VersionSaved="1.20.0.0"})
stones_count = Slider(2, range=0..10)
box = DomainBox(Base=Y, X=Domain(-10, 10), Y=Domain(-10, 10), Z=Domain(-10, 10))
sphere_1_repeat_x = Slider(1, range=0..100)
sphere_1_repeat_y = Slider(1, range=0..100)
sphere_2_repeat_x = Slider(1, range=0..100)
sphere_2_repeat_y = Slider(1, range=0..100)
sphere_1_rotation = Slider(0, range=0..180)
sphere_2_rotation = Slider(0, range=0..180)
sphere_1_map = ValueList({"Wood": "https://m.media-amazon.com/images/I/817Q3VCabwL.jpg", "Brick": "https://i.pinimg.com/736x/7a/6d/91/7a6d91f1ed72dd8da2715d6ca21b3b25.jpg", "Stone": "https://media.istockphoto.com/id/1410017441/vector/stone-wall-design-for-pattern-and-background-vector-illustration.jpg?s=612x612&w=0&k=20&c=2IY3PSG90KMqM--wgIK_pEBKBQVR8x0yvYr4mfwuWU4="}, selected="Wood")
sphere_2_map = ValueList({"Wood": "https://m.media-amazon.com/images/I/817Q3VCabwL.jpg", "Brick": "https://i.pinimg.com/736x/7a/6d/91/7a6d91f1ed72dd8da2715d6ca21b3b25.jpg", "Stone": "https://media.istockphoto.com/id/1410017441/vector/stone-wall-design-for-pattern-and-background-vector-illustration.jpg?s=612x612&w=0&k=20&c=2IY3PSG90KMqM--wgIK_pEBKBQVR8x0yvYr4mfwuWU4="}, selected="Brick")
mbox = MeshBox(Base=box, XCount=1, YCount=1, ZCount=1)
box_2 = DomainBox(Base=PlaneXY(0, 0, 0), X=Domain(0, 1), Y=Domain(0, 1), Z=Domain(0, 1))
stone_color_begin = ColourSwatch(SwatchColor=RGB(0, 255, 255))
stone_color_end = ColourSwatch(SwatchColor=RGB(255, 0, 255))
sphere_1_color = ColourSwatch(SwatchColor=RGB(255, 255, 0))
sphere_2_color = ColourSwatch(SwatchColor=RGB(0, 0, 255))
boxmap = BoxMapping(Mesh=mbox, Box=box_2)
series = Series(Start=0, Step=30, Count=stones_count)  # -> flatten(Series)
X = UnitX(Factor=30)
merge = Merge(Data1=stone_color_begin, Data2=stone_color_end, Data3=sphere_1_color, Data4=sphere_2_color)  # -> graft(Result)
one_over_x = OneOverX(Value=sphere_1_repeat_x)
one_over_x_2 = OneOverX(Value=sphere_1_repeat_y)
one_over_x_3 = OneOverX(Value=sphere_2_repeat_x)
one_over_x_4 = OneOverX(Value=sphere_2_repeat_y)
rad = Radians(Degrees=sphere_1_rotation)
rad_2 = Radians(Degrees=sphere_2_rotation)
panel = Panel("""sphere1
sphere2""")
move = Move(Geometry=boxmap, Motion=X)  # -> Geometry, Transform
gltf2material = GlTF20Material(
    Name="stone",
    BaseColorFactor=RGB(255, 255, 255),
    MetallicFactor=0,
    RoughnessFactor=1,
    EmissiveFactor=RGB(0, 0, 0),
    AlphaMode="OPAQUE",
    AlphaCutoff=0.5,
    DoubleSided=True)
X_2 = UnitX(Factor=series)
argb = SplitARGB(Colour=merge, IntegerChannels=True)  # -> Alpha, Red, Green, Blue
merge_2 = Merge(Data1=boxmap, Data2=move.Geometry)  # -> graft(Result)
move_2 = Move(Motion=X_2)  # -> Geometry, Transform
panel_2 = Panel("""gem
standard
standard""")
gltf2material_2 = GlTF20Material(
    Name=panel,
    BaseColorFactor=RGB(255, 255, 255),
    MetallicFactor=0,
    RoughnessFactor=1,
    EmissiveFactor=RGB(0, 0, 0),
    AlphaMode="OPAQUE",
    AlphaCutoff=0.5,
    DoubleSided=True)
merge_3 = Merge(Data1=argb.Red, Data2=argb.Green, Data3=argb.Blue, Data4=argb.Alpha)
merge_4 = Merge(
    Data1=sphere_1_map,
    Data2=sphere_2_map,
    Data3=one_over_x,
    Data4=one_over_x_2,
    Data5=one_over_x_3,
    Data6=one_over_x_4,
    Data7=rad,
    Data8=rad_2)
panel_3 = Panel("""stone.type
sphere1.type
sphere2.type
stone.colorTransferBegin
stone.colorTransferEnd
sphere1.color
sphere2.color
sphere1.map.image
sphere2.map.image
sphere1.map.repeat[0]
sphere1.map.repeat[1]
sphere2.map.repeat[0]
sphere2.map.repeat[1]
sphere1.map.rotation
sphere2.map.rotation""")
createtransformlist = CreateTransformList(Transforms=move_2.Transform)
entwine = Entwine(Branch0X=graft(panel_2), Branch1X=merge_3, Branch2X=graft(merge_4), FlattenInputs=False)
gltfdisplay = GlTF20Display(Geometry=merge_2, Material=gltf2material_2)
panel_4 = Panel("""transform
material""")
merge_5 = Merge(Data1=createtransformlist, Data2=gltf2material)
constructjson = ConstructJSON(Data=entwine, AddressString=panel_3)
constructattr = ConstructAttributes(Keys=panel_4, Values=merge_5)
stone_mesh = Mesh(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)
materialdatabase = DirectDataOutput(Data=constructjson)
injectattr = InjectAttributes(Object=stone_mesh, Attributes=constructattr)
gltfdisplay_2 = GlTF20Display(Geometry=injectattr)
