# Grasshopper definition webgitextureexample.ghx (Grasshopper 1.0.8)
# plug-ins: Human, ShapeDiverForGrasshopper, Swiftlet

# ---- group: Box Material
diffuse_map = Panel("""https://dl.polyhaven.org/file/ph-assets/Textures/jpg/1k/raw_plank_wall/raw_plank_wall_diff_1k.jpg
https://dl.polyhaven.org/file/ph-assets/Textures/jpg/1k/castle_brick_07/castle_brick_07_diff_1k.jpg
https://dl.polyhaven.org/file/ph-assets/Textures/jpg/1k/rock_face_03/rock_face_03_diff_1k.jpg""")
normal_map = Panel("""https://dl.polyhaven.org/file/ph-assets/Textures/jpg/1k/raw_plank_wall/raw_plank_wall_nor_gl_1k.jpg
https://dl.polyhaven.org/file/ph-assets/Textures/jpg/1k/castle_brick_07/castle_brick_07_nor_gl_1k.jpg
https://dl.polyhaven.org/file/ph-assets/Textures/jpg/1k/rock_face_03/rock_face_03_nor_gl_1k.jpg""")
roughness_map = Panel("""https://dl.polyhaven.org/file/ph-assets/Textures/jpg/1k/raw_plank_wall/raw_plank_wall_rough_1k.jpg
https://dl.polyhaven.org/file/ph-assets/Textures/jpg/1k/castle_brick_07/castle_brick_07_rough_1k.jpg
https://dl.polyhaven.org/file/ph-assets/Textures/jpg/1k/rock_face_03/rock_face_03_rough_1k.jpg""")
sphere_wrapping_type_u = ValueList({"Clamp to Edge Wrapping": 1001, "Repeat Wrapping": 1000, "Mirrored Repeat Wrapping": 1002}, selected="Repeat Wrapping")
sphere_wrapping_type_v = ValueList({"Clamp to Edge Wrapping": 1001, "Repeat Wrapping": 1000, "Mirrored Repeat Wrapping": 1002}, selected="Repeat Wrapping")
sphere_material = ValueList({"Wood": 0, "Brick": 1, "Stone": 2}, selected="Wood")
sphere_material_rotation = Slider(0, range=0..180)
sphere_size_u = Slider(10, range=0..100)
sphere_size_v = Slider(10, range=0..100)
sphere_color = ColourSwatch(SwatchColor=RGB(255, 255, 255))
item = ListItem(List=diffuse_map, Index=sphere_material, Wrap=True)
item_2 = ListItem(List=normal_map, Index=sphere_material, Wrap=True)
item_3 = ListItem(List=roughness_map, Index=sphere_material, Wrap=True)
cth = ColorToHex(Color=sphere_color)
rad = Radians(Degrees=sphere_material_rotation)
one_over_x = OneOverX(Value=sphere_size_u)
one_over_x_2 = OneOverX(Value=sphere_size_v)

# ----
cube_size = Slider(20, range=0..100)
sphere_radius = Slider(15, range=0..100)
pln = Base(PlaneXY(30.35973658, 30.06479423, 0))

# ---- group: Box Material
box_material = ValueList({"Yellow Gold Polished": 0, "Rose Gold Matt": 1, "Silver Polished": 2}, selected="Rose Gold Matt")
yellow_gold_polished_material = Panel("""{
  "metadata": {
    "version": 4.6,
    "type": "Material",
    "generator": "Material.toJSON"
  },
  "uuid": "dc4e3752-26fb-49de-85aa-a1cf939b1bdb",
  "type": "MeshStandardMaterial2",
  "name": "sphere",
  "color": 16695418,
  "roughness": 0,
  "metalness": 1,
  "sheen": 0,
  "sheenColor": 0,
  "sheenRoughness": 1,
  "emissive": 0,
  "specularIntensity": 1,
  "specularColor": 16777215,
  "clearcoat": 0,
  "clearcoatRoughness": 0,
  "iridescence": 0,
  "iridescenceIOR": 1.3,
  "iridescenceThicknessRange": [
    100,
    400
  ],
  "anisotropy": 0,
  "anisotropyRotation": 0,
  "envMapIntensity": 1,
  "reflectivity": 0.49999999999999983,
  "transmission": 0,
  "thickness": 0,
  "attenuationDistance": 0,
  "attenuationColor": 16777215,
  "side": 2,
  "depthFunc": 3,
  "depthTest": true,
  "depthWrite": true,
  "colorWrite": true,
  "stencilWrite": false,
  "stencilWriteMask": 255,
  "stencilFunc": 519,
  "stencilRef": 0,
  "stencilFuncMask": 255,
  "stencilFail": 7680,
  "stencilZFail": 7680,
  "stencilZPass": 7680,
  "fog": false,
  "userData": {
    "gltfExtensions": {},
    "cloneId": "0_1_1_1",
    "_6b1395aa-194b-4458-bd49-22ec4592cfc2_version": 1,
    "cloneCount": 0,
    "rootPath": "https://playground.ijewel3d.com/assets/materials/metal/polished/metal-yellowgold-polished.pmat",
    "uuid": "dc4e3752-26fb-49de-85aa-a1cf939b1bdb"
  },
  "textures": [],
  "images": []
}""")
rose_gold_matt_material = Panel("""{
  "metadata": {
    "version": 4.6,
    "type": "Material",
    "generator": "Material.toJSON"
  },
  "uuid": "0020ee88-a634-46f8-ad14-6146f90d1a43",
  "type": "MeshStandardMaterial2",
  "name": "sphere",
  "color": 13799534,
  "roughness": 0.3,
  "metalness": 0.8,
  "sheen": 0,
  "sheenColor": 0,
  "sheenRoughness": 1,
  "emissive": 0,
  "specularIntensity": 1,
  "specularColor": 16777215,
  "clearcoat": 0,
  "clearcoatRoughness": 0,
  "iridescence": 0,
  "iridescenceIOR": 1.3,
  "iridescenceThicknessRange": [
    100,
    400
  ],
  "anisotropy": 0,
  "anisotropyRotation": 0,
  "envMapIntensity": 1,
  "reflectivity": 0.40000000000000013,
  "transmission": 0,
  "thickness": 0,
  "attenuationDistance": 0,
  "attenuationColor": 16777215,
  "depthFunc": 3,
  "depthTest": true,
  "depthWrite": true,
  "colorWrite": true,
  "stencilWrite": false,
  "stencilWriteMask": 255,
  "stencilFunc": 519,
  "stencilRef": 0,
  "stencilFuncMask": 255,
  "stencilFail": 7680,
  "stencilZFail": 7680,
  "stencilZPass": 7680,
  "fog": false,
  "userData": {
    "rootPath": "https://playground.ijewel3d.com/assets/materials/metal/matt/metal-rosegold-matt.pmat",
    "cloneId": "0_1",
    "cloneCount": 0,
    "uuid": "0020ee88-a634-46f8-ad14-6146f90d1a43"
  },
  "textures": [],
  "images": []
}""")
silver_polished_material = Panel("""{
  "metadata": {
    "version": 4.6,
    "type": "Material",
    "generator": "Material.toJSON"
  },
  "uuid": "262c6ba5-b8b5-4ae1-a325-f5d6314e9c2f",
  "type": "MeshStandardMaterial2",
  "name": "sphere",
  "color": 16711422,
  "roughness": 0.06521739130434782,
  "metalness": 0.8804347826086957,
  "sheen": 0,
  "sheenColor": 0,
  "sheenRoughness": 1,
  "emissive": 0,
  "specularIntensity": 1,
  "specularColor": 16777215,
  "clearcoat": 0,
  "clearcoatRoughness": 0,
  "iridescence": 0,
  "iridescenceIOR": 1.3,
  "iridescenceThicknessRange": [
    100,
    400
  ],
  "anisotropy": 0,
  "anisotropyRotation": 0,
  "envMapIntensity": 1,
  "reflectivity": 0.49999999999999983,
  "transmission": 0,
  "thickness": 0,
  "attenuationDistance": 0,
  "attenuationColor": 16777215,
  "side": 2,
  "depthFunc": 3,
  "depthTest": true,
  "depthWrite": true,
  "colorWrite": true,
  "stencilWrite": false,
  "stencilWriteMask": 255,
  "stencilFunc": 519,
  "stencilRef": 0,
  "stencilFuncMask": 255,
  "stencilFail": 7680,
  "stencilZFail": 7680,
  "stencilZPass": 7680,
  "fog": false,
  "userData": {
    "rootPath": "https://playground.ijewel3d.com/assets/materials/metal/polished/metal-silver-polished.pmat",
    "cloneId": "0_1",
    "cloneCount": 0,
    "uuid": "262c6ba5-b8b5-4ae1-a325-f5d6314e9c2f"
  },
  "textures": [],
  "images": []
}""")
merge = Merge(Data1=yellow_gold_polished_material, Data2=rose_gold_matt_material, Data3=silver_polished_material)
item_4 = ListItem(List=merge, Index=box_material, Wrap=True)
parsejson = ParseJSON(JSON=item_4)

# ----
box = DomainBox(Base=PlaneXY(-11.34733383, 22.30624163, -11.13293659), X=cube_size, Y=cube_size, Z=cube_size)
msphere = MeshSphere(Base=pln, Radius=sphere_radius, UCount=10, VCount=20)
multiplication = Multiplication(A=sphere_radius, B=2)
mbox = MeshBox(Base=box, XCount=1, YCount=1, ZCount=1)
sphericalmap = SphericalMapping(Mesh=msphere, BasePlane=pln)  # -> MappedMesh, MappingSphere
scale = Scale(Center=pln, Factor=multiplication)  # -> Geometry, Transform
boxmap = BoxMapping(Mesh=mbox, Box={Plane=PlaneXY(0, 0, 0), X=Domain(0, 1), Y=Domain(0, 1), Z=Domain(0, 1)})
transformuv = TransformTextureUV(Mesh=sphericalmap.MappedMesh, Transform=scale.Transform)
panel = Panel("""stone
box
sphere""")
stone_mesh = Mesh(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)

# ---- group: Stone Material
reflectivity_factor = Slider(0.5, range=0..1)
ray_bounces = Slider(5, range=1..20)
stone_color = ColourSwatch(SwatchColor=RGB(0, 255, 255))
cth_2 = ColorToHex(Color=stone_color)

# ----
gltf2material = GlTF20Material(
    Name=panel,
    BaseColorFactor=RGB(255, 255, 255),
    MetallicFactor=0,
    RoughnessFactor=1,
    EmissiveFactor=RGB(0, 0, 0),
    AlphaMode="OPAQUE",
    AlphaCutoff=0.5,
    DoubleSided=True)
base_materials_json = Panel("""{
  "stone": {
    "type": "DiamondMaterial"
  },
  "box": {
    "type": "MeshStandardMaterial2",
    "map": "textuteMapID",
    "normalMap":"normalMapID",
    "roughnessMap":"roughnessMapID",
    "textures": [
      {
        "uuid": "textuteMapID"
      },
      {
        "uuid": "normalMapID"
      },
      {
        "uuid": "roughnessMapID"
      }
    ],
    "images": []
  },
  "sphere": {
    "type": "MeshStandardMaterial2",
    "map": "textuteMapID",
    "normalMap":"normalMapID",
    "roughnessMap":"roughnessMapID",
    "textures": [
      {
        "uuid": "textuteMapID"
      },
      {
        "uuid": "normalMapID"
      },
      {
        "uuid": "roughnessMapID"
      }
    ],
    "images": []
  },
}""")
panel_2 = Panel("""box
stone.color
stone.reflectivity
stone.rayBounces
sphere.color
sphere.textures[0].userData.rootPath
sphere.textures[1].userData.rootPath
sphere.textures[2].userData.rootPath
sphere.textures[0].wrap[0]
sphere.textures[1].wrap[0]
sphere.textures[2].wrap[0]
sphere.textures[0].wrap[1]
sphere.textures[1].wrap[1]
sphere.textures[2].wrap[1]
sphere.textures[0].repeat[0]
sphere.textures[1].repeat[0]
sphere.textures[2].repeat[0]
sphere.textures[0].repeat[1]
sphere.textures[1].repeat[1]
sphere.textures[2].repeat[1]
sphere.textures[0].rotation
sphere.textures[1].rotation
sphere.textures[2].rotation""")
merge_2 = Merge(Data1=stone_mesh, Data2=boxmap, Data3=transformuv)  # -> graft(Result)
geometry = GlTF20Display(Geometry=merge_2, Material=gltf2material)
merge_3 = Merge(
    Data1=parsejson,
    Data2=cth_2,
    Data3=reflectivity_factor,
    Data4=ray_bounces,
    Data5=cth,
    Data6=item,
    Data7=item_2,
    Data8=item_3,
    Data9=sphere_wrapping_type_u,
    Data10=sphere_wrapping_type_u,
    Data11=sphere_wrapping_type_u,
    Data12=sphere_wrapping_type_v,
    Data13=sphere_wrapping_type_v,
    Data14=sphere_wrapping_type_v,
    Data15=one_over_x,
    Data16=one_over_x,
    Data17=one_over_x,
    Data18=one_over_x_2,
    Data19=one_over_x_2,
    Data20=one_over_x_2,
    Data21=rad,
    Data22=rad,
    Data23=rad)  # -> graft(Result)
parsejson_2 = ParseJSON(JSON=base_materials_json)
constructjson = ConstructJSON(Object=parsejson_2, Data=merge_3, AddressString=panel_2)
materialdatabase = DirectDataOutput(Data=constructjson)
